# Grasshopper definition Mud structure.gh (Grasshopper 0.9.76)
# plug-ins: MeshEdit Components, Human, Kangaroo Components, Weaverbird

swatch = ColourSwatch(SwatchColor=RGB(255, 0, 0))

# ---- group: Working area
rectangle = Rectangle(Plane=PlaneXY(0, 0, 0), XSize="2000", YSize="2000", Radius=0)  # -> Rectangle, Length
dash = DashPattern(Curve=rectangle.Rectangle, Pattern=50)  # -> Dashes, Gaps
boundary = BoundarySurfaces(Edges=rectangle.Rectangle)
previewlw = CustomPreviewLineweights(Geometry=dash.Dashes, Shader=ColourSwatch(SwatchColor=RGB(128, 128, 128)), Thickness=3, Absolute=False)

# ---- group: Arch 1
height_1 = Slider(1000, range=100..2000)
inclination_1 = Slider(0, range=-45..45)
vector_force_1 = Slider(0.1, range=0..4)

# ---- group: Arch 2
vector_force_2 = Slider(0, range=0..4)
height_2 = Slider(1000, range=100..2000)
inclination_2 = Slider(0, range=-45..45)

# ---- group: Arch 3
height_3 = Slider(1000, range=100..2000)
inclination_3 = Slider(0, range=-45..45)
vector_force_3 = Slider(0, range=0..4)

# ---- group: Arch 4
height_4 = Slider(1000, range=100..2000)
inclination_4 = Slider(0, range=-45..45)
vector_force_4 = Slider(0, range=0..4)

# ---- group: Central Arch
height_5 = Slider(800, range=0..3000)
vector_force_5 = Slider(0, range=0..10)

# ---- group: Position 1
rotation_1 = Slider(0, range=-45..45)
md_slider = MDSlider(slider_value=Point(0, 1, 0.5), SliderMode=0, x_domain=Domain(0, 1), y_domain=Domain(0, 1), z_domain=Domain(0, 1))

# ---- group: Position 4
rotation_4 = Slider(0, range=-45..45)
md_slider_2 = MDSlider(slider_value=Point(0, 0, 0.5), SliderMode=0, x_domain=Domain(0, 1), y_domain=Domain(0, 1), z_domain=Domain(0, 1))

# ----
list = ValueList({"Ground Anchor Points": 0, "Naked Edges Anchor Points": 1}, selected="Ground Anchor Points")
list_2 = ValueList({"0 Iterations (no)": 0, "1000 Iterations (low)": 1000, "2000 Iterations (high)": 2000, "4000 Iterations (very high)": 4000}, selected="0 Iterations (no)")

# ---- group: Position 2
rotation_2 = Slider(0, range=-45..45)
md_slider_3 = MDSlider(slider_value=Point(1, 1, 0.5), SliderMode=0, x_domain=Domain(0, 1), y_domain=Domain(0, 1), z_domain=Domain(0, 1))

# ---- group: Position 3
rotation_3 = Slider(0, range=-45..45)
md_slider_4 = MDSlider(slider_value=Point(1, 0, 0.5), SliderMode=0, x_domain=Domain(0, 1), y_domain=Domain(0, 1), z_domain=Domain(0, 1))

# ----
support_diameter_with_minimum_considerat = Slider(0, range=0..400)  # "Support Diameter with Minimum Consideration"
merge = Merge(Data1=rotation_1, Data2=rotation_2, Data3=rotation_3, Data4=rotation_4)
merge_2 = Merge(Data1=md_slider, Data2=md_slider_3, Data3=md_slider_4, Data4=md_slider_2)

merge_3 = Merge(Data1=height_1, Data2=height_2, Data3=height_3, Data4=height_4)
merge_4 = Merge(Data1=inclination_1, Data2=inclination_2, Data3=inclination_3, Data4=inclination_4)
merge_5 = Merge(Data1=vector_force_1, Data2=vector_force_2, Data3=vector_force_3, Data4=vector_force_4)

evalsrf = EvaluateSurface(Surface=reparameterize(boundary), Point=merge_2)  # -> Point, Normal, Frame
number_slider = Slider(100000, range=0..100000)
kangaroo_settings = KangarooSettings(
    Tolerance=0.001,
    TimeStep=0.001,
    SubIterations=100,
    Floor=False,
    Drag=1,
    Restitution=0.7,
    StaticFriction=10,
    KineticFriction=10,
    Settle=2,
    Tumble=1,
    Sound=False,
    Solver=0)

# ---- group: Delimitation
panel = Panel("""{+1}
{-1}""")
pt = Point(simplify(graft(evalsrf.Point)))
relitem = RelativeItem(Tree=simplify(graft(pt)), Offset=panel, WrapPaths=invert(False), WrapItems=False)  # -> ItemA, ItemB
dist = Distance(PointA=relitem.ItemA, PointB=relitem.ItemB)
xy = XYPlane(Origin=pt)
avr = Average(Input=dist)
expression = Expression(x=avr, Expression="(x/3)/2")
max = Maximum(A=expression, B=support_diameter_with_minimum_considerat)

# ---- group: Central Arch
pt_2 = Point(simplify(graft(evalsrf.Point)))
item = ListItem(List=flatten(pt_2), Index=0, Wrap=True)  # -> Item, Item1, Item2, Item3
ln = Line(StartPoint=item.Item, EndPoint=item.Item2)
ln_2 = Line(StartPoint=item.Item1, EndPoint=item.Item3)
ccx = CurveCurve(CurveA=ln, CurveB=ln_2)  # -> Points, ParamsA, ParamsB
Z = UnitZ(Factor=height_5)
relitem_2 = RelativeItem(Tree=pt_2, Offset="{+2}", WrapPaths=False, WrapItems=False)  # -> ItemA, ItemB
move = Move(Geometry=ccx.Points, Motion=Z)  # -> Geometry, Transform
weave = Weave(Pattern=[0, 1], Stream0=[relitem_2.ItemA, relitem_2.ItemB], Stream1=move.Geometry, NullGaps=False)
Z_2 = UnitZ(Factor=1)
pt_3 = Point(weave)
amp = Amplitude(Vector=Z_2, Amplitude=vector_force_5)
vec = Vector(amp)
neg = Negative(Value=vec)
intcrv_t = InterpolateT(Vertices=pt_3, Degree=3, TangentStart=vec, TangentEnd=neg, KnotStyle=1)  # -> Curve, Length, Domain
crv = Curve(intcrv_t.Curve)
crv_cp = CurveClosestPoint(Point=move.Geometry, Curve=crv)  # -> Point, Parameter, Distance
shatter = Shatter(Curve=crv, Parameters=crv_cp.Parameter)  # -> flatten(Segments)
disc = Discontinuity(Curve=shatter, Level=1)  # -> Points, Parameters
pdecon = Deconstruct(Point=disc.Points)  # -> XComponent, YComponent, ZComponent
sort = SortList(Keys=pdecon.ZComponent, ValuesA=disc.Points)  # -> Keys, ValuesA
item_2 = ListItem(List=sort.ValuesA, Index=0, Wrap=True)  # -> flatten(Item)
crv_2 = Curve(intcrv_t.Curve)

# ---- group: Delimitation (continued)
vec2pt = Vector2Pt(PointA=pt, PointB=ccx.Points, Unitize=False)  # -> Vector, Length
vrot = Rotate(Vector=vec2pt.Vector, Axis=xy, Angle=-1.570796327)
vdis = VectorDisplay(Anchor=xy, Vector=vec2pt.Vector)
align = AlignPlane(Plane=xy, Direction=vrot)  # -> Plane, Angle
prot = RotatePlane(Plane=align.Plane, Angle=graft(degrees(merge)))
cir = Circle(Plane=prot, Radius=max)
divide = DivideCurve(Curve=cir, Count=2, Kinks=False)  # -> Points, Tangents, Parameters
pline = PolyLine(Vertices=flatten(divide.Points), Closed=invert(False))
explode = Explode(Curve=pline, Recursive=True)  # -> Segments, Vertices
dispatch = Dispatch(List=explode.Segments, DispatchPattern=[True, False])  # -> ListA, simplify(graft(ListB))
crv_3 = Curve(dispatch.ListB)

# ----
cluster = Cluster_2(pln=prot, S=Slider(86, range=0..100), C=ColourSwatch(SwatchColor=RGB(0, 153, 255)))

# ---- group: Side Arch
crv_4 = Curve(crv_3)
disc_2 = Discontinuity(Curve=crv_4, Level=1)  # -> simplify(Points), Parameters
avr_2 = Average(Input=disc_2.Points)
pl = PlaneNormal(Origin=avr_2, ZAxis=crv_4)
Z_3 = UnitZ(Factor=1)
rad = Radians(Degrees=merge_4)  # -> graft(Radians)
align_2 = AlignPlane(Plane=pl, Direction=Z_3)  # -> Plane, Angle
pt_4 = PointCylindrical(BasePlane=align_2.Plane, Angle=rad, Radius=graft(merge_3), Elevation=0)  # -> simplify(Point)
prot_2 = RotatePlane(Plane=align_2.Plane, Angle=rad)
deplane = DeconstructPlane(Plane=prot_2)  # -> Origin, XAxis, YAxis, ZAxis
weave_2 = Weave(Pattern=[0, 1], Stream0=disc_2.Points, Stream1=pt_4, NullGaps=False)
amp_2 = Amplitude(Vector=deplane.XAxis, Amplitude=graft(merge_5))
vec_2 = Vector(amp_2)
neg_2 = Negative(Value=vec_2)
intcrv_t_2 = InterpolateT(Vertices=weave_2, Degree=3, TangentStart=vec_2, TangentEnd=neg_2, KnotStyle=1)  # -> Curve, Length, Domain
shatter_2 = Shatter(Curve=reparameterize(intcrv_t_2.Curve), Parameters=0.5)
crv_5 = Curve(intcrv_t_2.Curve)

# ----
cluster_2 = Cluster(C=crv_5, S=Slider(70, range=0..100), C_2=swatch)

# ---- group: Central Arch (continued)
disc_3 = Discontinuity(Curve=crv_3, Level=1)  # -> Points, Parameters
cp = ClosestPoint(Point=disc_3.Points, Cloud=item_2)  # -> ClosestPoint, CPIndex, Distance
item_3 = ListItem(List=shatter, Index=cp.CPIndex, Wrap=True)  # -> simplify(Item)

# ---- group: Surfaces
crv_6 = Curve(crv_3)
flip = FlipCurve(Curve=item_3, Guide=crv_6)  # -> graft(Curve), Flag
flip_2 = FlipCurve(Curve=shatter_2, Guide=crv_6)  # -> graft(Curve), Flag
rulesrf = RuledSurface(CurveA=flip.Curve, CurveB=flip_2.Curve)

# ---- group: Meshing
srf = Surface(rulesrf)
number_slider_2 = Slider(10, range=0..10)
mesh_uv = MeshSurface(Surface=srf, UCount=Slider(16, range=0..20), VCount=number_slider_2, Overhang=True, Equalize=False)  # -> simplify(Mesh)
turn = MeshTurn(Mesh=mesh_uv)
clean = CombineClean(Meshes=flatten(turn))
preview = CustomPreview(Geometry=clean, Shader=ColourSwatch(SwatchColor=RGBA(36, 36, 36, 22)))

# ---- group: WB relaxation
mesh_uv_2 = MeshSurface(Surface=srf, UCount=Slider(4, range=0..20), VCount=Slider(1, range=0..10), Overhang=True, Equalize=False)
clean_2 = CombineClean(Meshes=flatten(mesh_uv_2))
wbcatmullclark = WeaverbirdsCatmullClarkSubdivision(MeshCurves=clean_2, Level=2, SmoothNakedEdges=2)

# ---- group: Mesh Edge Separation
medges = MeshEdges(Mesh=clean)  # -> NakedEdges, InteriorEdges, NonManifoldEdges
crv_7 = Curve(medges.InteriorEdges)
eval = EvaluateCurve(Curve=reparameterize(crv_7), Parameter=0.5)  # -> Point, Tangent, Angle
crv_8 = Curve(intcrv_t.Curve)
crv_cp_2 = CurveClosestPoint(Point=eval.Point, Curve=crv_8)  # -> Point, Parameter, Distance
smaller = SmallerThan(FirstNumber=crv_cp_2.Distance, SecondNumber=5)  # -> SmallerThan, OrEqualTo
crv_9 = Curve(medges.NakedEdges)
flip_3 = FlipMatrix(Data=smaller.SmallerThan)
eval_2 = EvaluateCurve(Curve=reparameterize(crv_9), Parameter=0.5)  # -> Point, Tangent, Angle
item_4 = ListItem(List=flip_3, Index=0, Wrap=True)  # -> Item, Item1
pdecon_2 = Deconstruct(Point=eval_2.Point)  # -> XComponent, YComponent, ZComponent
or = GateOr(A=item_4.Item, B=item_4.Item1)  # -> flatten(Result)
smaller_2 = SmallerThan(FirstNumber=pdecon_2.ZComponent, SecondNumber=0.1)  # -> SmallerThan, OrEqualTo
dispatch_2 = Dispatch(List=crv_7, DispatchPattern=or)  # -> ListA, ListB
dispatch_3 = Dispatch(List=crv_9, DispatchPattern=smaller_2.SmallerThan)  # -> ListA, ListB

# ---- group: Central Arch Bending
join = JoinCurves(Curves=dispatch_2.ListA, Preserve=False)
polylinebend = PolyLineBend(polyline=join, bendstrength=number_slider, B=Slider(1, range=0..1))  # -> L, B_2

# ---- group: Side Arch Bending
join_2 = JoinCurves(Curves=dispatch_3.ListB, Preserve=False)
polylinebend_2 = PolyLineBend(polyline=join_2, bendstrength=number_slider, B=Slider(0, range=0..1))  # -> L, B_2

# ----
crv_10 = Curve(dispatch_2.ListB)

# ---- group: Planarize mesh quadrants
explode_2 = MeshExplode(Mesh=clean, Interpolate=False)
demesh = DeconstructMesh(Mesh=explode_2)  # -> Vertices, Faces, Colours, Normals
item_5 = ListItem(List=demesh.Vertices, Index=0, Wrap=True)  # -> Item, Item1, Item2, Item3
planarize = Planarize(Point1=item_5.Item, Point2=item_5.Item1, Point3=item_5.Item2, Point4=item_5.Item3, PlanarizeStrength=1000)

# ---- group: Mesh springs
crv_11 = Curve(crv_10)
len = Length(Curve=crv_11)
multiplication = Multiplication(A=len, B=Slider(0.8, range=0..2))
springs = SpringsFromLine(
    Connection=crv_11,
    Stiffness=Slider(10, range=0..1000),
    Damping=Slider(100, range=0..100),
    RestLength=multiplication,
    UpperCutoff=multiplication,
    LowerCutoff=0,
    Plasticity=0)

# ---- group: Central Arch Spring
crv_12 = Curve(polylinebend.L)
len_2 = Length(Curve=crv_12)
multiplication_2 = Multiplication(A=len_2, B=Slider(1, range=0..2))
springs_2 = SpringsFromLine(
    Connection=crv_12,
    Stiffness=Slider(2000, range=0..2000),
    Damping=Slider(100, range=0..100),
    RestLength=multiplication_2,
    UpperCutoff=0,
    LowerCutoff=0,
    Plasticity=Slider(100, range=0..100))

# ---- group: Side Arch Springs
crv_13 = Curve(polylinebend_2.L)
len_3 = Length(Curve=crv_13)
multiplication_3 = Multiplication(A=len_3, B=Slider(1.05, range=0..2))
springs_3 = SpringsFromLine(
    Connection=crv_13,
    Stiffness=Slider(2000, range=0..2000),
    Damping=Slider(100, range=0..100),
    RestLength=multiplication_3,
    UpperCutoff=0,
    LowerCutoff=0,
    Plasticity=Slider(100, range=0..100))

# ---- group: shell adaptation
shell = Shell(M=clean, strength=Slider(0, range=0..400), B=Slider(0, range=0..1))

# ---- group: Anchor Points
wbvertices = WeaverbirdsVerticesComponent(MeshClosedPolylinesGroup=clean, Weld=True)
pdecon_3 = Deconstruct(Point=wbvertices)  # -> XComponent, YComponent, ZComponent
equals = Equality(FirstNumber=pdecon_3.ZComponent, SecondNumber=0)  # -> Equality, Inequality
cull = CullPattern(List=wbvertices, CullPattern=equals.Equality)

# ---- group: Mesh Smooth
smooth = MeshSmooth(mesh=clean, strength=Slider(1000, range=0..1000))

# ---- group: gravity
wbvertices_2 = WeaverbirdsVerticesComponent(MeshClosedPolylinesGroup=clean, Weld=True)
uforce = UnaryForce(Point=wbvertices_2, Force=Vector(0, 0, -9.8))

# ---- group: Naked Edge Anchor Points
nv = NakedVertices(Mesh=clean)  # -> ClothedIndex, NakedIndex, ClothedPts, NakedPts

# ----
filter = StreamFilter(Gate=list, Stream0=cull, Stream1=nv.NakedPts)
data = Data(flatten([springs_3, springs_2, springs, shell, uforce, polylinebend_2.B_2, polylinebend.B_2, planarize, smooth]))
pt_5 = Point(flatten(filter))
zombie = ZombieKangaroo(
    ForceObjects=flatten(data),
    AnchorPoints=flatten(pt_5),
    Settings=kangaroo_settings,
    Geometry=clean,
    Threshold=0.1,
    MaxIters=list_2)  # -> Out, Iterations, ParticlesOut, GeometryOut, KE
mesh = Mesh(zombie.GeometryOut)
project = Project(Geometry=mesh, Plane=PlaneXY(0, 0, 0))  # -> Geometry, Transform
preview_2 = CustomPreview(Geometry=mesh, Shader=ColourSwatch(SwatchColor=RGBA(255, 255, 255, 193)))
preview_3 = CustomPreview(Geometry=project.Geometry, Shader=ColourSwatch(SwatchColor=RGBA(36, 36, 36, 86)))

stripper = Stripper(Mesh=mesh)
partition = PartitionList(List=stripper, Size=number_slider_2)
clean_3 = CombineClean(Meshes=partition)
turn_2 = MeshTurn(Mesh=clean_3)
stripper_2 = Stripper(Mesh=turn_2)
unroller = Unroller(Strip=stripper_2, Unroll=1)  # -> simplify(Unrolled)
explode_3 = MeshExplode(Mesh=unroller, Interpolate=False)
item_6 = ListItem(List=reverse(explode_3), Index=0, Wrap=True)
demesh_2 = DeconstructMesh(Mesh=item_6)  # -> Vertices, Faces, Colours, Normals
item_7 = ListItem(List=demesh_2.Vertices, Index=0, Wrap=True)  # -> Item, Item1, Item2
ln_3 = Line(StartPoint=item_7.Item, EndPoint=item_7.Item1)
ln_4 = Line(StartPoint=item_7.Item1, EndPoint=item_7.Item2)
pl_2 = ConstructPlane(Origin=item_7.Item, XAxis=ln_3, YAxis=ln_4)  # -> simplify(Plane)
pt_6 = Point(Point(3272.254686, -1267.090405, 0))
pshift = ShiftPaths(Data=pl_2, Offset=-1)
tstat = TreeStatistics(Tree=pshift)  # -> Paths, Length, Count
series = Series(Start=0, Step=Slider(1325, range=0..2000), Count=tstat.Count)  # -> graft(Series)
series_2 = Series(Start=0, Step=Slider(234, range=0..1000), Count=tstat.Length)
pt_7 = ConstructPoint(XCoordinate=series_2, YCoordinate=series, ZCoordinate=0)
addition = Addition(A=pt_7, B=pt_6)
orient = Orient(Geometry=unroller, Source=pshift, Target=addition)  # -> Geometry, Transform
medges_2 = MeshEdges(Mesh=orient.Geometry)  # -> NakedEdges, InteriorEdges, NonManifoldEdges
join_3 = JoinCurves(Curves=medges_2.NakedEdges, Preserve=False)

# ---- group: Arch visualization and lenght calculation
mesh_2 = Mesh(mesh)
stripper_3 = Stripper(Mesh=mesh_2)
partition_2 = PartitionList(List=stripper_3, Size=number_slider_2)
medges_3 = MeshEdges(Mesh=mesh_2)  # -> NakedEdges, InteriorEdges, NonManifoldEdges
clean_4 = CombineClean(Meshes=partition_2)
medges_4 = MeshEdges(Mesh=clean_4)  # -> NakedEdges, InteriorEdges, NonManifoldEdges
crv_14 = Curve(medges_3.InteriorEdges)
crv_15 = Curve(medges_3.NakedEdges)
eval_3 = EvaluateCurve(Curve=reparameterize(crv_14), Parameter=0.5)  # -> Point, Tangent, Angle
dupln = RemoveDuplicateLines(Lines=flatten(medges_4.NakedEdges), Tolerance=0.01)
eval_4 = EvaluateCurve(Curve=reparameterize(crv_15), Parameter=0.5)  # -> Point, Tangent, Angle
pdecon_4 = Deconstruct(Point=eval_4.Point)  # -> XComponent, YComponent, ZComponent
pull = PullPoint(Point=eval_3.Point, Geometry=dupln, ClosestOnly=True)  # -> ClosestPoint, Distance
smaller_3 = SmallerThan(FirstNumber=pdecon_4.ZComponent, SecondNumber=0.1)  # -> SmallerThan, OrEqualTo
ln_5 = Line(StartPoint=eval_3.Point, EndPoint=pull.ClosestPoint)
smaller_4 = SmallerThan(FirstNumber=pull.Distance, SecondNumber=5)  # -> SmallerThan, OrEqualTo
dispatch_4 = Dispatch(List=crv_14, DispatchPattern=smaller_4.SmallerThan)  # -> ListA, ListB
dispatch_5 = Dispatch(List=crv_15, DispatchPattern=smaller_3.SmallerThan)  # -> ListA, ListB
crv_16 = Curve(flatten(dispatch_4.ListA))
join_4 = JoinCurves(Curves=dispatch_5.ListB, Preserve=False)
join_5 = JoinCurves(Curves=crv_16, Preserve=False)
len_4 = Length(Curve=join_4)
len_5 = Length(Curve=join_5)
pipe = Pipe(Curve=dispatch_5.ListB, Radius=5, Caps=1)
pipe_2 = Pipe(Curve=join_5, Radius=5, Caps=1)
panel_2 = Panel(len_4)
panel_3 = Panel(len_5)
preview_4 = CustomPreview(Geometry=pipe, Shader=swatch)
preview_5 = CustomPreview(Geometry=pipe_2, Shader=ColourSwatch(SwatchColor=RGB(0, 255, 4)))

# ==== cluster Shell: Give a mesh bending stiffness. AngleFactor sets the rest state - 0 is flat, 1 keeps the original angles
M = ClusterInput()
c_script = CSharpScript(M=M)  # -> out, A, B, C, D; inputs M: Mesh
# ---------- c_script: C# ----------
    //your code here…

    if (M != null)
    {
      List < Point3d > EdgeEnd1 = new List<Point3d>();
      List < Point3d > EdgeEnd2 = new List<Point3d>();
      List < Point3d > Tip1 = new List<Point3d>();
      List < Point3d > Tip2 = new List<Point3d>();
      M.Faces.ConvertQuadsToTriangles();
      Point3d[] VertexPts = M.Vertices.ToPoint3dArray();

      for (int i = 0; i < M.TopologyEdges.Count; i++)
      {
        int[] ConnectedFaces = M.TopologyEdges.GetConnectedFaces(i);

        if (ConnectedFaces.Length == 2)
        {
          EdgeEnd1.Add(M.TopologyEdges.EdgeLine(i).From);
          EdgeEnd2.Add(M.TopologyEdges.EdgeLine(i).To);

          int[] adjacentface1points = M.TopologyVertices.IndicesFromFace(ConnectedFaces[0]);
          int[] adjacentface2points = M.TopologyVertices.IndicesFromFace(ConnectedFaces[1]);
          IndexPair EndTopologyVertices = M.TopologyEdges.GetTopologyVertices(i);

          for (int j = 0; j < 3; j++)
          {
            if (adjacentface1points[j] != EndTopologyVertices.I)
            {
              if (adjacentface1points[j] != EndTopologyVertices.J)
              {
                int Tip1TopologyVertex = adjacentface1points[j];
                int[] Tip1VertexIndex = M.TopologyVertices.MeshVertexIndices(Tip1TopologyVertex);
                Tip1.Add(VertexPts[Tip1VertexIndex[0]]);
              }
            }
            if (adjacentface2points[j] != EndTopologyVertices.I)
            {
              if (adjacentface2points[j] != EndTopologyVertices.J)
              {
                int Tip2TopologyVertex = adjacentface2points[j];
                int[] Tip2VertexIndex = M.TopologyVertices.MeshVertexIndices(Tip2TopologyVertex);
                Tip2.Add(VertexPts[Tip2VertexIndex[0]]);
              }
            }
          }
        }
      }
      A = EdgeEnd1;
      B = EdgeEnd2;
      C = Tip1;
      D = Tip2;
    }
# ---------- end c_script ----------
fa = FoldAngle(Point1=c_script.A, Point2=c_script.B, Point3=c_script.C, Point4=c_script.D)
B = ClusterInput()
multiplication = Multiplication(A=fa, B=B)
strength = ClusterInput()
hinge = Hinge(Point1=c_script.A, Point2=c_script.B, Point3=c_script.C, Point4=c_script.D, Strength=strength, RestAngle=multiplication)
H = ClusterOutput(hinge)

# ==== cluster PolyLineBend: PolyLineBend
polyline = ClusterInput()
polyline_2 = Curve(polyline)
cls = Closed(Curve=polyline_2)  # -> Closed, Periodic
explode = Explode(Curve=polyline_2, Recursive=True)  # -> Segments, Vertices
split = SplitList(List=explode.Vertices, Index=1)  # -> ListA, ListB
shift = ShiftList(List=explode.Vertices, Shift=0, Wrap=False)
shift_2 = ShiftList(List=explode.Vertices, Shift=1, Wrap=False)
shift_3 = ShiftList(List=explode.Vertices, Shift=2, Wrap=False)
shift_4 = ShiftList(List=split.ListB, Shift=0, Wrap=True)
shift_5 = ShiftList(List=split.ListB, Shift=1, Wrap=True)
shift_6 = ShiftList(List=split.ListB, Shift=2, Wrap=True)
filter = StreamFilter(Gate=cls.Closed, Stream0=shift_3, Stream1=shift_6)
filter_2 = StreamFilter(Gate=cls.Closed, Stream0=shift_2, Stream1=shift_5)
filter_3 = StreamFilter(Gate=cls.Closed, Stream0=shift, Stream1=shift_4)
short = ShortList(ListA=filter_3, ListB=filter_2, TrimMode=2)  # -> ListA, ListB
short_2 = ShortList(ListA=filter_3, ListB=filter_2, ListC=filter, TrimMode=2)  # -> ListA, ListB, ListC
ln = Line(StartPoint=short.ListA, EndPoint=short.ListB)
L = ClusterOutput(ln)
vec2pt = Vector2Pt(PointA=short_2.ListA, PointB=short_2.ListB, Unitize=False)  # -> Vector, Length
vec2pt_2 = Vector2Pt(PointA=short_2.ListB, PointB=short_2.ListC, Unitize=False)  # -> Vector, Length
angle = Angle(VectorA=vec2pt.Vector, VectorB=vec2pt_2.Vector)  # -> Angle, Reflex
B = ClusterInput()
multiplication = Multiplication(A=angle.Angle, B=B)
bendstrength = ClusterInput()
bend = Bend(Point1=short_2.ListA, Point2=short_2.ListB, Point3=short_2.ListC, BendStrength=bendstrength, RestAngle=multiplication)
B_2 = ClusterOutput(bend)

# ==== cluster MeshSmooth: Apply Laplacian Smoothing to a mesh
mesh = ClusterInput()
mesh_2 = Mesh(mesh)
nv = NakedVertices(Mesh=mesh_2)  # -> Clothed, Naked, ClothedPts, NakedPts
vn = VertexNeighbours(Mesh=mesh_2, VertexNumber=nv.Clothed)  # -> Vertex, Neighbours, Normal
strength = ClusterInput()
laplacian = Laplacian(Center=graft(vn.Vertex), Neighbours=vn.Neighbours, Strength=strength, Weighting=0)  # -> flatten(Laplacian)
L = ClusterOutput(laplacian)

# ==== cluster Cluster
C = ClusterInput()
S = ClusterInput()
C_2 = ClusterInput()

eval = EvaluateCurve(Curve=reparameterize(C), Parameter=0.5)  # -> Point, Tangent, Angle
Z = UnitZ(Factor=100)
lng = ListLength(List=flatten(eval.Point))
move = Move(Geometry=eval.Point, Motion=Z)  # -> flatten(Geometry), Transform
series = Series(Start=1, Step=1, Count=lng)
xz = XZPlane(Origin=move.Geometry)
int = Integer(series)
tag = TextTag3D(Location=xz, Text=int, Size=S, Colour=C_2, Justification=5)

# ==== cluster Cluster_2
pln = ClusterInput()
S = ClusterInput()
C = ClusterInput()
pln_2 = Plane(pln)
deplane = DeconstructPlane(Plane=pln_2)  # -> Origin, XAxis, YAxis, ZAxis
amp = Amplitude(Vector=deplane.YAxis, Amplitude=100)
lng = ListLength(List=flatten(pln_2))
move = Move(Geometry=deplane.Origin, Motion=expr("-x", amp))  # -> Geometry, Transform
series = Series(Start=1, Step=1, Count=lng)
int = Integer(series)
tag = TextTag3D(Location=flatten(move.Geometry), Text=int, Size=S, Colour=C, Justification=5)
